# Dynamo graph RevitDebugTab.dyn (Dynamo 2.10.1.3976)

debugTab = Python()  # IronPython2
# ---------- debugTab.python (18 lines) ----------
# Load the Python Standard and DesignScript Libraries
import sys
import clr
clr.AddReference('UIFramework')

from UIFramework import RevitRibbonControl

# The inputs to this node will be stored as a list in the IN variables.

# Place your code below this line

ribbonControl = RevitRibbonControl.RibbonControl

if not ribbonControl.Tabs.Contains(ribbonControl.DebugTab):
	ribbonControl.Tabs.Add(ribbonControl.DebugTab)

# Assign your output to the OUT variable.
#OUT = 0
# ----------------------------------------
